# Dynamo graph circle_test.dyn (Dynamo 2.4.0.6186)

number = DoubleInput(0)
number_2 = DoubleInput(10)
number_3 = DoubleInput(2)
sequence = Sequence(start=number, amount=number_2, step=number_3)
byCoordinates = Point.ByCoordinates(x=sequence, y=sequence, lacing=CrossProduct)
flatten = List.Flatten(list=byCoordinates)
number_slider = DoubleSlider(15.342, range=0..100 step 0.1)
number_slider_2 = DoubleSlider(14.7, range=0..100 step 0.1)
byCoordinates_2 = Point.ByCoordinates(x=number_slider, y=number_slider_2, lacing=CrossProduct)
distanceTo = Geometry.DistanceTo(geometry=flatten, other=byCoordinates_2)
number_slider_3 = DoubleSlider(17.1, range=0..100 step 0.1)
code_block = CodeBlock(x=distanceTo, y=number_slider_3) { x/(y+0.001); }
byCenterPointRadius = Circle.ByCenterPointRadius(centerPoint=flatten, radius=code_block)
