# Dynamo graph hexagonal with attractor.dyn (Dynamo 2.4.0.6186)
# packages: LunchBox for Dynamo 2018.7.6

number_slider = DoubleSlider(0, range=0..100 step 0.1)  # graph input
number_slider_2 = DoubleSlider(0, range=0..100 step 0.1)  # graph input
byCoordinates = Point.ByCoordinates(x=number_slider, y=number_slider_2)
number_slider_3 = DoubleSlider(0, range=0..100 step 0.1)  # graph input
number_slider_4 = DoubleSlider(10, range=0..100 step 0.1)  # graph input
byCoordinates_2 = Point.ByCoordinates(x=number_slider_3, y=number_slider_4)
number_slider_5 = DoubleSlider(0, range=0..100 step 0.1)  # graph input
number_slider_6 = DoubleSlider(20, range=0..100 step 0.1)  # graph input
byCoordinates_3 = Point.ByCoordinates(x=number_slider_5, y=number_slider_6)
number_slider_7 = DoubleSlider(0, range=0..100 step 0.1)  # graph input
number_slider_8 = DoubleSlider(30, range=0..100 step 0.1)  # graph input
byCoordinates_4 = Point.ByCoordinates(x=number_slider_7, y=number_slider_8)
create = List.Create(item0=byCoordinates, item1=byCoordinates_2, item2=byCoordinates_3, item3=byCoordinates_4)
byPoints = NurbsCurve.ByPoints(points=create)
number_slider_9 = DoubleSlider(10, range=0..100 step 0.1)  # graph input
number_slider_10 = DoubleSlider(0, range=0..100 step 0.1)  # graph input
byCoordinates_5 = Point.ByCoordinates(x=number_slider_9, y=number_slider_10)
number_slider_11 = DoubleSlider(12.4, range=0..100 step 0.1)  # graph input
number_slider_12 = DoubleSlider(14.7, range=0..100 step 0.1)  # graph input
byCoordinates_6 = Point.ByCoordinates(x=number_slider_11, y=number_slider_12)
number_slider_13 = DoubleSlider(10, range=0..100 step 0.1)  # graph input
number_slider_14 = DoubleSlider(19.8, range=0..100 step 0.1)  # graph input
byCoordinates_7 = Point.ByCoordinates(x=number_slider_13, y=number_slider_14)
number_slider_15 = DoubleSlider(10, range=0..100 step 0.1)  # graph input
number_slider_16 = DoubleSlider(30, range=0..100 step 0.1)  # graph input
byCoordinates_8 = Point.ByCoordinates(x=number_slider_15, y=number_slider_16)
create_2 = List.Create(item0=byCoordinates_5, item1=byCoordinates_6, item2=byCoordinates_7, item3=byCoordinates_8)
byPoints_2 = NurbsCurve.ByPoints(points=create_2)
number_slider_17 = DoubleSlider(20, range=0..100 step 0.1)  # graph input
number_slider_18 = DoubleSlider(0, range=0..100 step 0.1)  # graph input
byCoordinates_9 = Point.ByCoordinates(x=number_slider_17, y=number_slider_18)
number_slider_19 = DoubleSlider(21.545, range=0..100 step 0.1)  # graph input
number_slider_20 = DoubleSlider(15.7, range=0..100 step 0.1)  # graph input
byCoordinates_10 = Point.ByCoordinates(x=number_slider_19, y=number_slider_20)
number_slider_21 = DoubleSlider(17.033, range=0..100 step 0.1)  # graph input
number_slider_22 = DoubleSlider(20.03, range=0..100 step 0.1)  # graph input
byCoordinates_11 = Point.ByCoordinates(x=number_slider_21, y=number_slider_22)
number_slider_23 = DoubleSlider(20, range=0..100 step 0.1)  # graph input
number_slider_24 = DoubleSlider(30, range=0..100 step 0.1)  # graph input
byCoordinates_12 = Point.ByCoordinates(x=number_slider_23, y=number_slider_24)
create_3 = List.Create(item0=byCoordinates_9, item1=byCoordinates_10, item2=byCoordinates_11, item3=byCoordinates_12)
byPoints_3 = NurbsCurve.ByPoints(points=create_3)
number_slider_25 = DoubleSlider(30, range=0..100 step 0.1)  # graph input
number_slider_26 = DoubleSlider(0, range=0..100 step 0.1)  # graph input
byCoordinates_13 = Point.ByCoordinates(x=number_slider_25, y=number_slider_26)
number_slider_27 = DoubleSlider(30, range=0..100 step 0.1)  # graph input
number_slider_28 = DoubleSlider(10, range=0..100 step 0.1)  # graph input
byCoordinates_14 = Point.ByCoordinates(x=number_slider_27, y=number_slider_28)
number_slider_29 = DoubleSlider(30, range=0..100 step 0.1)  # graph input
number_slider_30 = DoubleSlider(20, range=0..100 step 0.1)  # graph input
byCoordinates_15 = Point.ByCoordinates(x=number_slider_29, y=number_slider_30)
number_slider_31 = DoubleSlider(30, range=0..100 step 0.1)  # graph input
number_slider_32 = DoubleSlider(30, range=0..100 step 0.1)  # graph input
byCoordinates_16 = Point.ByCoordinates(x=number_slider_31, y=number_slider_32)
create_4 = List.Create(item0=byCoordinates_13, item1=byCoordinates_14, item2=byCoordinates_15, item3=byCoordinates_16)
byPoints_4 = NurbsCurve.ByPoints(points=create_4)
create_5 = List.Create(item0=byPoints, item1=byPoints_2, item2=byPoints_3, item3=byPoints_4)
byLoft = Surface.ByLoft(crossSections=create_5)
code_block = CodeBlock { 20; }
code_block_2 = CodeBlock { 0.27; }
panelHexagon = Geometry.Panel.PanelHexagon(srf=byLoft, u=code_block, v=code_block, t=code_block_2)
boolean = BoolSelector(true)  # graph input
byPoints_5 = PolyCurve.ByPoints(points=panelHexagon.HexPoints, connectLastToFirst=boolean)
code_block_3 = CodeBlock { 10; }
byWidthLength = Rectangle.ByWidthLength(width=code_block_3, length=code_block_3)
byPatch = Surface.ByPatch(closedCurve=byWidthLength)
code_block_4 = CodeBlock { 0..10; }
code_block_5 = CodeBlock(x=code_block_4) { x/10; }
pointAtParameter = Surface.PointAtParameter(surface=byLoft, u=code_block_5, v=code_block_5, lacing=CrossProduct)
