# Dynamo graph lunchbox_grid.dyn (Dynamo 2.4.0.6186)
# packages: LunchBox for Dynamo 2018.7.6

code_block = CodeBlock { 5; }
byWidthLength = Rectangle.ByWidthLength(width=code_block, length=code_block)
byPatch = Surface.ByPatch(closedCurve=byWidthLength)
number_slider = DoubleSlider(15, range=0..15 step 1)
lunchbox_quad_grid_by_face = Custom[LunchBox Quad Grid by Face](sur=byPatch, U=number_slider, V=number_slider)  # package LunchBox for Dynamo; Create a quadrangular XYZ grid on a face. The face surface must have an untrimmed UV parameter space.
flatten = List.Flatten(list=lunchbox_quad_grid_by_face.Panel_Polys)
number_slider_2 = DoubleSlider(0.2, range=0..100 step 0.1)
extrude = Curve.Extrude(curve=flatten, direction=number_slider_2)
number_slider_3 = DoubleSlider(0.1, range=0..100 step 0.1)
thicken = Surface.Thicken(surface=extrude, thickness=number_slider_3)
