# Dynamo graph lunchbox_grid_cylinder.dyn (Dynamo 2.4.0.6186)
# packages: LunchBox for Dynamo 2018.7.6

byCoordinates = Point.ByCoordinates()
number_slider = DoubleSlider(6.6, range=0..100 step 0.1)
byCenterPointRadius = Circle.ByCenterPointRadius(centerPoint=byCoordinates, radius=number_slider)
number_slider_2 = DoubleSlider(10, range=0..100 step 0.1)
extrude = Curve.Extrude(curve=byCenterPointRadius, distance=number_slider_2)
number_slider_3 = DoubleSlider(1, range=0..100 step 0.1)
boolean = BoolSelector(true)
thicken = Surface.Thicken(surface=extrude, thickness=number_slider_3, both_sides=boolean)
number_slider_4 = DoubleSlider(15, range=8..15 step 1)
lunchbox_quad_grid_by_face = Custom[LunchBox Quad Grid by Face](sur=extrude, U=number_slider_4, V=number_slider_4)  # package LunchBox for Dynamo; Create a quadrangular XYZ grid on a face. The face surface must have an untrimmed UV parameter space.
byCornerPoints = Rectangle.ByCornerPoints(points=lunchbox_quad_grid_by_face.Panel_Pts)
number_slider_5 = DoubleSlider(-0.1, range=-0.1..100 step 0.1)
offset = Curve.Offset(curve=byCornerPoints, distance=number_slider_5)
byPatch = Surface.ByPatch(closedCurve=offset)
number_slider_6 = DoubleSlider(2, range=-0.1..100 step 0.1)
boolean_2 = BoolSelector(true)
thicken_2 = Surface.Thicken(surface=byPatch, thickness=number_slider_6, both_sides=boolean_2)
differenceAll = Solid.DifferenceAll(solid=thicken, others=thicken_2)
