# Dynamo graph lunchbox_wave.dyn (Dynamo 2.4.0.6186)
# packages: LunchBox for Dynamo 2018.7.6

number = DoubleInput(50)
number_slider = DoubleSlider(0.182, range=0..1 step 0.001)
number_slider_2 = DoubleSlider(3.968, range=0..10 step 0.001)
number_slider_3 = DoubleSlider(7, range=0..10 step 1)
number_2 = DoubleInput(0)
number_3 = DoubleInput(8)
lunchbox_wave = Custom[LunchBox Wave](U=number, V=number, A=number_slider, B=number_slider_2, S=number_slider_3, U0=number_2, U1=number_3, V0=number_2, V1=number_3)  # package LunchBox for Dynamo; Creates a parametric Wave surface
