# Dynamo custom node loop_wave_spring.dyf (Dynamo 2.4.1.6394)
# category: Ampersand.Geometry
# wave_springをコピーし上に重ねていく

geometry = Input(geometry: Autodesk.DesignScript.Geometry.Geometry)
height_offset = Input(height_offset: var[]..[])
Number = Input(Number: var[]..[])
code_block = CodeBlock(x=height_offset, y=Number) { x*y; }
range = Range(start=height_offset, end=code_block, step=height_offset)
byCoordinates = Vector.ByCoordinates(z=range)
translate = Geometry.Translate(geometry=geometry, direction=byCoordinates)
byCoordinates_2 = Point.ByCoordinates()
code_block_2 = CodeBlock { 1; }
byCoordinates_3 = Vector.ByCoordinates(z=code_block_2)
degree_offset = Input(degree_offset: var[]..[])
code_block_3 = CodeBlock(x=degree_offset, y=Number) { x*y; }
range_2 = Range(start=degree_offset, end=code_block_3, step=degree_offset)
rotate = Geometry.Rotate(geometry=translate, origin=byCoordinates_2, axis=byCoordinates_3, degrees=range_2)
Geometry = Output(rotate)
