# Dynamo custom node make_wave_circle.dyf (Dynamo 2.4.1.6394)
# category: Ampersand.Geometry.Curve
# wave_springの線を作成する

code_block = CodeBlock { 0..(360); }
sin = Math.Sin(angle=code_block)
circle_size = Input(circle_size: var)
mul = sin * circle_size
cos = Math.Cos(angle=code_block)
mul_2 = cos * circle_size
misalignment_correction = Input(misalignment_correction: var)
mul_3 = code_block * misalignment_correction
sin_2 = Math.Sin(angle=mul_3)
wave_height = Input(wave_height: var)
mul_4 = sin_2 * wave_height
height_misalignment = Input(height_misalignment: var)
mul_5 = code_block * height_misalignment
add = mul_4 + mul_5
byCoordinates = Point.ByCoordinates(x=mul, y=mul_2, z=add)
code_block_2 = CodeBlock(x=byCoordinates) { x[0..359]; }
boolean = BoolSelector(true)
byPoints = PolyCurve.ByPoints(points=code_block_2, connectLastToFirst=boolean)
PolyCurve = Output(byPoints)
