# Dynamo custom node make_wave_spring.dyf (Dynamo 2.4.0.6186)
# category: Ampersand.Geometry
# wave_springを作成する

height_offset = Input(height_offset: var)
thickness = Input(thickness: var)
circle_size = Input(circle_size: var)
misalignment_correction = Input(misalignment_correction: var)
wave_height = Input(wave_height: var)
height_misalignment = Input(height_misalignment: var)
make_wave_circle = Custom[make_wave_circle](circle_size=circle_size, misalignment_correction=misalignment_correction, wave_height=wave_height, height_misalignment=height_misalignment)  # wave_springの線を作成する
circle_diff = Input(circle_diff: var)
sub = circle_size - circle_diff
make_wave_circle_2 = Custom[make_wave_circle](circle_size=sub, misalignment_correction=misalignment_correction, wave_height=wave_height, height_misalignment=height_misalignment)
make_wave_spring_solid = Custom[make_wave_spring_solid](thickness=thickness, big_circle=make_wave_circle, small_circle=make_wave_circle_2)  # wave_springのsolidを作成
Number = Input(Number: var)
degree_offset = Input(degree_offset: var)
loop_wave_spring = Custom[loop_wave_spring](height_offset=height_offset, geometry=make_wave_spring_solid, Number=Number, degree_offset=degree_offset)  # wave_springをコピーし上に重ねていく
Geometry = Output(loop_wave_spring)
