# Dynamo graph wave_spring.dyn (Dynamo 2.4.1.6394)

code_block = CodeBlock { 0..(360); }
sin = Math.Sin(angle=code_block)

# group: 円の大きさ
number_slider = DoubleSlider(8.6, range=1..100 step 0.1)

mul = sin * number_slider
cos = Math.Cos(angle=code_block)
mul_2 = cos * number_slider

# group: ズレの補正
number_slider_2 = DoubleSlider(6, range=0.1..10 step 0.001)

mul_3 = code_block * number_slider_2
sin_2 = Math.Sin(angle=mul_3)

# group: 波の高さ
number_slider_3 = DoubleSlider(1.34, range=0.1..10 step 0.01)

mul_4 = sin_2 * number_slider_3

# group: 高さのズレ(0=ずれなしの平面)
number_slider_4 = DoubleSlider(0, range=0..100 step 0.1)

mul_5 = code_block * number_slider_4
add = mul_4 + mul_5
byCoordinates = Point.ByCoordinates(x=mul, y=mul_2, z=add)
code_block_2 = CodeBlock(x=byCoordinates) { x[0..359]; }
boolean = BoolSelector(true)
byPoints = PolyCurve.ByPoints(points=code_block_2, connectLastToFirst=boolean)

# group: 厚み
number_slider_5 = DoubleSlider(1, range=0..100 step 0.1)

code_block_3 = CodeBlock(x=number_slider_5) { -x; }
code_block_4 = CodeBlock { 0..(360); }
sin_3 = Math.Sin(angle=code_block_4)

# group: 外円と内円の厚さ
number_slider_6 = DoubleSlider(2, range=1..100 step 0.1)

sub = number_slider - number_slider_6
mul_6 = sin_3 * sub
cos_2 = Math.Cos(angle=code_block_4)
mul_7 = cos_2 * sub
mul_8 = code_block_4 * number_slider_2
sin_4 = Math.Sin(angle=mul_8)
mul_9 = sin_4 * number_slider_3
mul_10 = code_block_4 * number_slider_4
add_2 = mul_9 + mul_10
byCoordinates_2 = Point.ByCoordinates(x=mul_6, y=mul_7, z=add_2)
code_block_5 = CodeBlock(x=byCoordinates_2) { x[0..359]; }
boolean_2 = BoolSelector(true)
byPoints_2 = PolyCurve.ByPoints(points=code_block_5, connectLastToFirst=boolean_2)
code_block_6 = CodeBlock(x=byPoints, y=byPoints_2) { [x,y]; }
byLoft = PolySurface.ByLoft(crossSections=code_block_6)
byCoordinates_3 = Vector.ByCoordinates(z=number_slider_5)
translate = Geometry.Translate(geometry=byLoft, direction=byCoordinates_3)
extrude = Curve.Extrude(curve=byPoints_2, distance=code_block_3)

# group: エラーが出ない方法
extrude_2 = Curve.Extrude(curve=byPoints, distance=code_block_3)
code_block_7 = CodeBlock(a=extrude_2, b=translate, c=byLoft, d=extrude) { [a,b,c,d]; }
byJoinedSurfaces = PolySurface.ByJoinedSurfaces(surfaces=code_block_7)
extractSolids = PolySurface.ExtractSolids(polySurface=byJoinedSurfaces)

code_block_8 = CodeBlock { 3.34; }
byCoordinates_4 = Vector.ByCoordinates(z=code_block_8)
translate_2 = Geometry.Translate(geometry=extractSolids, direction=byCoordinates_4)
byCoordinates_5 = Point.ByCoordinates()
code_block_9 = CodeBlock { 1; }
byCoordinates_6 = Vector.ByCoordinates(z=code_block_9)
code_block_10 = CodeBlock { 30; }
rotate = Geometry.Rotate(geometry=translate_2, origin=byCoordinates_5, axis=byCoordinates_6, degrees=code_block_10)
code_block_11 = CodeBlock(x=extractSolids, y=rotate) { [x[0],y[0]]; }
byUnion = Solid.ByUnion(solids=code_block_11)
file_path = Filename(".\wave_spring")
exportToSAT = ExportWithUnits(geometry=byUnion, filePath=file_path, SelectedExportedUnitsSource=[0, 1, 2, 3, 5, 4], SelectedExportedUnit=2)
