# Dynamo graph wave_spring_ver2.dyn (Dynamo 2.4.1.6394)

# group: 円の大きさ
number_slider = DoubleSlider(8.6, range=1..100 step 0.1)

# group: ズレの補正
number_slider_2 = DoubleSlider(6, range=0.1..10 step 0.001)

# group: 波の高さ
number_slider_3 = DoubleSlider(1, range=0.1..10 step 0.01)

# group: 高さのズレ(0=ずれなしの平面)
number_slider_4 = DoubleSlider(0, range=0..100 step 0.1)

# group: 外円と内円の厚さ
number_slider_5 = DoubleSlider(2, range=1..100 step 0.1)

# group: 厚み
number_slider_6 = DoubleSlider(1, range=0..100 step 0.1)

# group: 各層の高さ方向のズレ
code_block = CodeBlock { 2.8; }

# group: 重ねる個数
code_block_2 = CodeBlock { 4; }

# group: 各層の角度(degree)のズレ
code_block_3 = CodeBlock { 30; }

make_wave_spring = Custom[make_wave_spring](circle_size=number_slider, misalignment_correction=number_slider_2, wave_height=number_slider_3, height_misalignment=number_slider_4, circle_diff=number_slider_5, thickness=number_slider_6, height_offset=code_block, Number=code_block_2, degree_offset=code_block_3)  # wave_springを作成する
byUnion = Solid.ByUnion(solids=make_wave_spring)
exportToSAT = ExportWithUnits(SelectedExportedUnitsSource=[0, 1, 2, 3, 5, 4], SelectedExportedUnit=2)  # unwired: geometry
file_path = Filename(".\wave_spring_data_ver2.sat")
