# Dynamo graph woven_ball.dyn (Dynamo 2.4.0.6186)

number_slider = DoubleSlider(10, range=0..100 step 0.1)
byCenterPointRadius = Circle.ByCenterPointRadius(radius=number_slider)
number = DoubleInput(0)
number_2 = DoubleInput(15)
code_block = CodeBlock(Num=number_2) { 1/Num; }
sequence = Sequence(start=number, amount=number_2, step=code_block)
pointAtParameter = Curve.PointAtParameter(curve=byCenterPointRadius, param=sequence)
number_slider_2 = DoubleSlider(17.2, range=0..100 step 0.1)
byCenterPointRadius_2 = Circle.ByCenterPointRadius(centerPoint=pointAtParameter, radius=number_slider_2)
number_slider_3 = DoubleSlider(2, range=0..100 step 0.1)
extrudeAsSolid = Curve.ExtrudeAsSolid(curve=byCenterPointRadius_2, direction=number_slider_3)
number_slider_4 = DoubleSlider(10.2, range=0..100 step 0.1)
byCenterPointRadius_3 = Circle.ByCenterPointRadius(radius=number_slider_4)
pointAtParameter_2 = Curve.PointAtParameter(curve=byCenterPointRadius_3, param=sequence)
number_slider_5 = DoubleSlider(16.5, range=0..100 step 0.1)
byCenterPointRadius_4 = Circle.ByCenterPointRadius(centerPoint=pointAtParameter_2, radius=number_slider_5)
extrudeAsSolid_2 = Curve.ExtrudeAsSolid(curve=byCenterPointRadius_4, direction=number_slider_3)
difference = Solid.Difference(solid=extrudeAsSolid, other=extrudeAsSolid_2)
byCoordinates = Point.ByCoordinates()
byCoordinates_2 = Point.ByCoordinates()
byTwoPoints = Vector.ByTwoPoints(start=byCoordinates_2, end=pointAtParameter)
number_slider_6 = DoubleSlider(88, range=-500..500 step 0.1)
rotate = Geometry.Rotate(geometry=difference, origin=byCoordinates, axis=byTwoPoints, degrees=number_slider_6)
byCoordinates_3 = Point.ByCoordinates()
number_3 = DoubleInput(1)
byCoordinates_4 = Vector.ByCoordinates(z=number_3)
number_4 = DoubleInput(90)
rotate_2 = Vector.Rotate(vector=byTwoPoints, axis=byCoordinates_4, degrees=number_4)
number_slider_7 = DoubleSlider(-78, range=-500..500 step 0.1)
rotate_3 = Geometry.Rotate(geometry=rotate, origin=byCoordinates_3, axis=rotate_2, degrees=number_slider_7)
number_slider_8 = DoubleSlider(2.5, range=0..100 step 0.1)
scale = Geometry.Scale(geometry=rotate_3, amount=number_slider_8)
file_path = Filename("..\..\..\..\Desktop\woven_ball")
exportToSAT = ExportWithUnits(geometry=scale, filePath=file_path, SelectedExportedUnitsSource=[0, 1, 2, 3, 5, 4], SelectedExportedUnit=2)
